# Grasshopper definition ASSIGNMENT01.gh (Grasshopper 1.0.7)
# plug-ins: Kangaroo2 Components

polygone_radius = Slider(12, range=1..20)
polygone_sides = Slider(3, range=3..10)
polygon_fillet = Slider(0, range=0..1)
height_of_levels = Slider(10, range=0..10)
number_of_levels = Slider(8, range=1..10)
twist_amount = Slider(90, range=0..90)
growth_rate = Slider(0.31, range=0.01..1)
growth_direction = Slider(0, range=0..1)
pipe_amount = Slider(12, range=1..20)
pipe_radius = Slider(0.48, range=0.01..1)
bool = Boolean(growth_direction)
polygon_radius = GetInteger(polygone_radius, AtLeast=1, AtMost=1, Maximum=2147483647, Minimum=-2147483648, TreeAccess=False)
polygon_sides = GetInteger(polygone_sides, AtLeast=1, AtMost=1, Maximum=2147483647, Minimum=-2147483648, TreeAccess=False)
polygon_fillet_2 = GetNumber(polygon_fillet, AtLeast=1, AtMost=1, Maximum=1.797693135e+308, Minimum=-1.797693135e+308, TreeAccess=False)
height_of_levels_2 = GetInteger(height_of_levels, AtLeast=1, AtMost=1, Maximum=2147483647, Minimum=-2147483648, TreeAccess=False)
number_of_levels_2 = GetInteger(number_of_levels, AtLeast=1, AtMost=1, Maximum=2147483647, Minimum=-2147483648, TreeAccess=False)
twist_amount_2 = GetInteger(twist_amount, AtLeast=1, AtMost=1, Maximum=2147483647, Minimum=-2147483648, TreeAccess=False)
growth_rate_2 = GetNumber(growth_rate, AtLeast=1, AtMost=1, Maximum=1.797693135e+308, Minimum=-1.797693135e+308, TreeAccess=False)
growth_direction_2 = GetBoolean(bool, AtLeast=1, AtMost=1, FalseValue="False", TreeAccess=False, TrueValue="True")
pipe_amount_2 = GetNumber(pipe_amount, AtLeast=1, AtMost=1, Maximum=1.797693135e+308, Minimum=-1.797693135e+308, TreeAccess=False)
pipe_radius_2 = GetNumber(pipe_radius, AtLeast=1, AtMost=1, Maximum=1.797693135e+308, Minimum=-1.797693135e+308, TreeAccess=False)
pt = Point(Point(0, 0, 0))
polygon = Polygon(Plane=pt, Radius=polygon_radius, Segments=polygon_sides, FilletRadius=polygon_fillet_2)  # -> Polygon, Length
series = Series(Start=0, Step=height_of_levels_2, Count=number_of_levels_2)
series_2 = Series(Start="1", Step=1, Count=number_of_levels_2)
rad = Radians(Degrees=twist_amount_2)
Z = UnitZ(Factor=series)
move = Move(Geometry=polygon.Polygon, Motion=Z)  # -> Geometry, Transform
multiplication = Multiplication(A=series_2, B=rad)
multiplication_2 = Multiplication(A=series_2, B=growth_rate_2)
rev = ReverseList(List=multiplication_2)
filter = StreamFilter(Gate=growth_direction_2, Stream0=multiplication_2, Stream1=rev)
rotate = Rotate(Geometry=move.Geometry, Angle=multiplication, Plane=PlaneXY(0, 0, 0))  # -> Geometry, Transform
area = Area(Geometry=rotate.Geometry)  # -> Area, Centroid
scale = Scale(Geometry=rotate.Geometry, Center=area.Centroid, Factor=filter)  # -> Geometry, Transform
divide = DivideCurve(Curve=scale.Geometry, Count=pipe_amount_2, Kinks=False)  # -> Points, Tangents, Parameters
flip = FlipMatrix(Data=divide.Points)
intcrv = Interpolate(Vertices=flip, Degree=3, Periodic=False, KnotStyle=1)  # -> Curve, Length, Domain
merge = Merge(Data1=scale.Geometry, Data2=intcrv.Curve)  # -> flatten(Result)
mp = MultiPipe(Curves=merge, NodeSize=pipe_radius_2, EndOffset=1, StrutSize=1, Segment=0, KinkAngle=0.6, CubeFit=0, Caps=0)
output = Geometry(mp)
context_bake = ContextBake(TWISTED_GEOMETRY=output)
